# Grasshopper definition VisualizeDataExample.gh (Grasshopper 1.0.7)
# plug-ins: VisFroG

path = FilePath("..\example\ExampleData.csv")
file = ReadFile(File=path, PerLineParse=True)
panel = Panel(""",
 """)
split = TextSplit(Text=file, Separators=panel)
panel_2 = Panel(split)
visfrog = VISualizationFRameworkFOrGrasshopper(GenericInputData=split)
