# Grasshopper definition example.gh (Grasshopper 1.0.8)
# plug-ins: VisuAlFroG

path = FilePath("..\example\example-data.csv")
file = ReadFile(File=path, PerLineParse=True)
split = TextSplit(Text=file, Separators=";")
panel = Panel(split)
visualfrog = VisualAnalyticsFrameworkForGrasshopper(GenericInputData=split)
panel_2 = Panel(visualfrog)
